# Grasshopper definition NOGrasshopperUtil.gh (Grasshopper 0.9.62)
# Copyright: Nono 2013

# CRV: Line With Center, Direction, Length
pt = ConstructPoint(XCoordinate=0, YCoordinate=0, ZCoordinate=0)
# NOGrasshopperUtil
# 
# Developed by Nono Martínez Alonso (@nonoesp)
# LIST: Remove List Extremes
panel = Panel("1,2,3,4,5,6,7")
split = TextSplit(Text=panel, Separators=",")

start = Slider(1, range=0..10)
end = Slider(1, range=0..10)
remove_extremes = RemoveExtremes(list=split, start=start, end=end)
cluster = Cluster(center=pt, direction=Vector(0, 0, 1), length=Slider(0.06, range=0..0.1))

panel_2 = Panel(remove_extremes)

# ==== cluster RemoveExtremes
end = ClusterInput()
start = ClusterInput()
list = ClusterInput()
lng = ListLength(List=list)
subtraction = Subtraction(A=lng, B=Slider(1, range=0..10))
subtraction_2 = Subtraction(A=subtraction, B=end)
dom = ConstructDomain(DomainStart=start, DomainEnd=subtraction_2)
subset = SubList(List=list, Domain=dom, Wrap=True)  # -> List, Index
sublist = ClusterOutput(subset.List)

# ==== cluster Cluster
center = ClusterInput()
direction = ClusterInput()
length = ClusterInput()
division = Division(A=length, B="2")
neg = Negative(Value=division)
line = LineSDL(Start=graft(center), Direction=direction, Length=[division, neg])  # -> flatten(Line)
join = JoinCurves(Curves=line, Preserve=False)
C = ClusterOutput(join)
